# Dynamo graph script.dyn (Dynamo 2.10.1.3976)

element_types = ElementTypes("ImportInstance")
all_elements_of_type = ElementsOfType(element_type=element_types)
delete = Element.Delete(element=all_elements_of_type)
