# Dynamo graph script.dyn (Dynamo 2.10.1.3976)

categories = Categories("OST_RvtLinks")
all_elements_of_category = ElementsOfCategory(Category=categories)
boolean = BoolSelector(true)  # graph input
setPinnedStatus = Element.SetPinnedStatus(element=all_elements_of_category, pinned=boolean)
watch = Watch(setPinnedStatus)
categories_2 = Categories("OST_Grids")
all_elements_of_category_2 = ElementsOfCategory(Category=categories_2)
boolean_2 = BoolSelector(true)  # graph input
setPinnedStatus_2 = Element.SetPinnedStatus(element=all_elements_of_category_2, pinned=boolean_2)
watch_2 = Watch(setPinnedStatus_2)
categories_3 = Categories("OST_Levels")
all_elements_of_category_3 = ElementsOfCategory(Category=categories_3)
boolean_3 = BoolSelector(true)  # graph input
setPinnedStatus_3 = Element.SetPinnedStatus(element=all_elements_of_category_3, pinned=boolean_3)
watch_3 = Watch(setPinnedStatus_3)
