# Dynamo graph script.dyn (Dynamo 2.10.1.3976)

element_types = ElementTypes("Group")
all_elements_of_type = ElementsOfType(element_type=element_types)
ungroupElements = Group.UngroupElements(group=all_elements_of_type)
watch = Watch(ungroupElements)
